# Grasshopper definition 02_visualise_flemish_bond_ghpython.ghx (Grasshopper 1.0.7)

show = BooleanToggle(True)
py = PythonScript()  # -> DATA
# ---------- py: Python ----------
import os

HERE = os.path.dirname(ghdoc.Path)
DATA = os.path.abspath(os.path.join(HERE, "data"))
# ---------- end py ----------
assembly = PythonScript(DATA=py, filename="flemish_bond.json", show=show)  # -> assembly, G
# ---------- assembly: Python ----------
import os
import sys

# Set assembly path
ASSEMBLY_PATH = os.path.abspath(os.path.join(DATA, ".."))
sys.path.append(ASSEMBLY_PATH)

from assembly import Assembly
from assembly.ghpython import AssemblyArtist

filepath = os.path.join(DATA, filename)
assembly = Assembly.from_json(filepath)

if show:
    artist = AssemblyArtist(assembly)
    G = artist.draw()
# ---------- end assembly ----------
preview = CustomPreview(Geometry=assembly.G, Shader=ColourSwatch(SwatchColor=RGBA(201, 145, 71, 218)))
